# Grasshopper definition toolpath_nonplanar-slicing_beta-15.gh (Grasshopper 1.0.8)
# plug-ins: Toolpaths.Fdm, Toolpaths.Gh

# ----
# TOOLPATHS
# developed by JÜNGERKÜHN
# contact: toolpaths@juengerkuehn.com
# juengerkuehn.com
# github.com/KonradJuenger/TOOLPATHS
# 1. transform mesh to a shape that can be sliced planarly
mesh = Mesh(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)
geo = Geometry(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)
planar_transform = PlanarTransform(Mesh=mesh, BaseUpper=geo, GridCellSize=5)  # -> PlanarMesh, TransformData, Warnings

toggle = BooleanToggle(True)
# 2. use any method to generate curves or toolpaths
fdm_vase = FDMVaseModeGenerator(
    Geometry=planar_transform.PlanarMesh,
    LayerHeight=Slider(3, range=0..10),
    Pitch=toggle,
    SamplingMode=toggle,
    Divisions=24,
    Length=1,
    AlternatingPattern=False)  # -> Curves, UnresampledCurve, StartCurves, EndCurves
fdm_toolpath = FDMToolpath(Curve=fdm_vase.Curves, EWidth=Slider(6, range=0..10))

# ----
# 3. untransfrom the toolpaths to match the orginal shape
non_planar_transform = NonPlanarTransform(Input=fdm_toolpath, TransformData=planar_transform.TransformData)  # -> Output, Warnings

machine = FDMMachine(
    NozzleDiameter=Slider(6, range=0..10),
    FilamentDiameter=1.75,
    G0RapidSpeed=200,
    MaxZSpeed=6,
    EPosAbsRel=0,
    HomeBeforePrint=False,
    CenterPrintXY=False)

defaults = FDMDefaults(
    HeightfieldResolution=Slider(0.3, range=0..1),
    SafeClearance=Slider(6, range=0..10),
    ZHopHeight=Slider(2, range=0..10),
    MeshingResolution=Slider(0.5, range=0..1),
    SmoothingWindow=Slider(1, range=0..100),
    DegenerateAspectRatio=Slider(20, range=0..100),
    MinLayerHeight=Slider(0.1, range=0..0.1),
    MaxLayerHeight=Slider(4.4, range=0..10))

processor = FDMProcessor(Toolpaths=non_planar_transform.Output, Machine=machine, Defaults=defaults, HFTime=-1, DebugOutputs=False)  # -> SimulationData, Errors, Warnings, HFPoints, SamplePoints, SampleHeights, TripleProbeTree

# ----
# use baking to output actual geometry to grasshopper. (slow)
toggle_2 = BooleanToggle(False)

# ----
# use the color componet to define custom colors
swatch = ColourSwatch(SwatchColor=RGB(90, 158, 242))
colors = Colors(FDMExtrusion=swatch, FDMTravel=ColourSwatch(SwatchColor=RGB(252, 254, 255)))

# ----
# increase the segement count to make the extrusion mesh rounder
number_slider = Slider(3, range=0..10)

# ----
# FDM simulator
number_slider_2 = Slider(1, range=0..1)

fdm_sim = FDMSimulator(
    SimulationData=processor.SimulationData,
    Time=number_slider_2,
    Play=Toggle(False),
    Speed=1,
    StadiumSegments=number_slider,
    BakeMeshes=toggle_2,
    Colors=colors)  # -> CurrentTime, Meshes, ToolPosition, ProgramDuration
